# Grasshopper definition layered_shapes_v1_03.gh (Grasshopper 1.0.8)

# Layered Shapes
# Developed by Jason Cross
# Durango CO, USA
panel = Panel("""small_1250_2
medium_2000_1
large_4000_2""")
number_slider = Slider(200, range=2..3000)

# ----
# size_width_count
panel_2 = Panel("""small_1250_3
medium_2000_3
large_4000_3""")

# ----
# Project Area Layer Path
panel_3 = Panel("Grid")

run = BooleanToggle(False)
run_2 = BooleanToggle(False)
active = Python3Script(path=panel_3)  # -> active
# ---------- active: Python ----------
import Rhino as rh
import Rhino.Geometry as rg
import scriptcontext as sc


# set env to Rhino
sc.doc = rh.RhinoDoc.ActiveDoc

# get the objects from the perimeter layer
areas_idx = sc.doc.Layers.FindByFullPath("Grid::areas", -1)
print(areas_idx)

a_list = ["A", "B"]
rows = [f"Grid::rows{el}::clouds" for el in a_list]
active = rows + [
    "RH_User_Input::struts",
    "RH_User_Input::dovetails",
    "RH_User_Input::obstructions",
]
# ---------- end active ----------
crv = Curve(<curve referenced from the Rhino model>)
pt = Point(<point referenced from the Rhino model>)
ironpython_2_script = IronPython2Script(areas=active)  # inputs areas: list of String
# ---------- ironpython_2_script: IronPython ----------
__organization__ = "Impact Acoustic"
__author__ = "JC"

import Rhino
import scriptcontext as sc 
import rhinoscriptsyntax as rh
import Grasshopper as gh 


sc.doc = Rhino.RhinoDoc.ActiveDoc

grid_layers = sc.doc.Layers
# print([layer for layer in grid_layers])



row_keys = ["Area_A","Area_B","Area_C"]
# Options component name
row_compnent_name = "Areas"

# Iterate the canvas for match
for obj in ghenv.Component.OnPingDocument().Objects:
    # check name value
    if obj.NickName == row_compnent_name:
        if obj.ListItems.Count > 0:
            selected = obj.SelectedItems 
        else:
            selected = None
        #
        obj.ListItems.Clear()
    
        for k,v in zip(row_keys, row_keys):
            vli = gh.Kernel.Special.GH_ValueListItem(k.strip(), '"{}"'.format(v))
            obj.ListItems.Add(vli)

        if selected is not None:
            for i, item in enumerate(selected):
                obj.ToggleItem(row_keys.index(item.Name))

        obj.ExpireSolution(True)


areas = sc.doc.Layers.FindName("areas")
for obj in sc.doc.Objects.FindByLayer(areas):
    print(obj.Geometry)

# grid_row_paths = ["Grid::rowsA::rows","Grid::rowsB::rows","Grid::rowsC::rows"]
# perimeter = sc.doc.Layers.Find("perimeter", True)
# perimeter_curves = [sc.doc.Objects.FindByLayer("perimeter")]
# print(perimeter_curves[0][0].Geometry.IsClosed)
# print(perimeter_curves[0][0].Geometry)
# perimeter_curves = [crv.Geometry for crv in perimeter.Get]

# for path in grid_row_paths:
#     path_idx = sc.doc.Layers.FindByFullPath(path,-1)
#     layer = sc.doc.Layers.FindIndex(path_idx)
#     layer_objects = sc.doc.Objects.FindByLayer(layer)



# grid_row_keys = ["rowsA","rowsB","rowsC"]
# # Options component name
# grid_row_compnent_name = "Row Layers"

# # Iterate the canvas for match
# for obj in ghenv.Component.OnPingDocument().Objects:
#     # check name value
#     if obj.NickName == grid_row_compnent_name:
#         if obj.ListItems.Count > 0:
#             selected = obj.SelectedItems 
#         else:
#             selected = None
#         #
#         obj.ListItems.Clear()
    
#         for k,v in zip(grid_row_keys, grid_row_keys):
#             vli = gh.Kernel.Special.GH_ValueListItem(k.strip(), '"{}"'.format(v))
#             obj.ListItems.Add(vli)

#         if selected is not None:
#             for i, item in enumerate(selected):
#                 obj.ToggleItem(grid_row_keys.index(item.Name))

#         obj.ExpireSolution(True)
# ---------- end ironpython_2_script ----------

srf = Surface(<surface referenced from the Rhino model>)
object_planes = Python3Script(surface=srf, distance=Slider(10, range=10..1000))  # -> a, f, b, c, d, e, g, h; inputs surface: Surface, distance: Double
# ---------- object_planes: Python ----------
import Rhino as rh 
import Rhino.Geometry as rg 
import scriptcontext as sc 

#
# srfA = surface
# srfB = surface.Offset(10, .01)
#
# planeA = srfA.TryGetPlane()[1]
# planeB = srfB.TryGetPlane()[1]
# #
# a_circle = rg.Circle(planeA , 100)
# b_circle = rg.Circle(planeB , 100)
# #
# a_edge = srfA.ToBrep().Edges[2]

# ptX = a_circle.Center
# ptY = a_edge.PointAt(-a_edge.GetLength()/2)
# ptZ = b_circle.Center
# #

edge_top = surface.ToBrep().Edges[2]
edge_btm = surface.ToBrep().Edges[0]
edge_right = surface.ToBrep().Edges[1]
top_pt = edge_top.PointAt(-edge_top.GetLength()/2)
btm_pt = edge_btm.PointAt(edge_top.GetLength()/2)
right_pt_mid = edge_right.PointAt(edge_top.GetLength()/2)
right_pt_top = edge_right.PointAtStart
centerline = rg.Line(top_pt, btm_pt).ToNurbsCurve()
centerpoint = centerline.PointAt(centerline.GetLength()/2)



mid_length = edge_top.GetLength() / 2
vecX = edge_top.PointAt(mid_length + 1) - edge_top.PointAt(mid_length)
print(vecX)

# Calculate vecY
vecY = centerline.PointAt(1) - centerline.PointAt(0)
print(vecY)

start, end = centerline.PointAtStart, centerline.PointAtEnd
if start.Z < end.Z: centerline.Reverse()
a_plane = rg.Plane(centerline.PointAtStart, vecX, vecY)
# a_plane = rg.Plane(centerline.PointAtStart, vX, vec)



a = a_plane
h = centerline
d = centerpoint
# ptBtm = a_edge_btm.PointAt(a_edge_btm.GetLength()/2)
# #
# centerline = rg.Line(a_edge.PointAt(-a_edge.GetLength()/2), ptBtm ).ToNurbsCurve()
# #
# a_plane = rg.Plane(ptX, ptY, ptZ )

# h = rg.Rectangle3d(planeA, -100, 100)


# point_list = []
# for loc in centerline.DivideByLength(50, False):
#     point = centerline.PointAtLength(loc)
#     point_list.append(point)



# ptA = a_edge.PointAt(-a_edge.GetLength()/2)
# ptB = a_edge.PointAt(-((a_edge.GetLength()/2)+distance))



# moved = []
# for pt in point_list:
#     xform = rg.Transform.Translation(pt.X-ptB.X, pt.Y-ptB.Y, 0)
#     pt.Transform(xform)
# # a_ptX, a_ptX, a_ptZ = a_point.Duplicate(),a_point.Duplicate(),a_point.Duplicate()

# # a_ptX.X = a_point.X
# a_vector = rg.Vector3d(a_circle.Center.X-b_circle.Center.X, a_circle.Center.Y-b_circle.Center.Y, 0)
# a_vector.Reverse()

# a = srfA
# b = a_circle
# c = a_edge
# d = point_list
# f = a_plane
# e = a_circle.Center
# g = a_vector
# ---------- end object_planes ----------
crv_2 = Curve(object_planes.b)
pt_2 = Point(object_planes.d)
crv_3 = Curve(object_planes.h)
pln = Plane(object_planes.f)
crv_4 = Curve(object_planes.c)
vdis = VectorDisplay(Anchor=object_planes.e, Vector=object_planes.g)
pln_2 = Plane(object_planes.a)

# ----
# Project Bakery
# Create Grid & Elements
cloud_maker = Python3Script(project_info=panel_2, default_baffle_depth=number_slider, origin_point=pt, RUN=run)  # inputs origin_point: Point3d
# ---------- cloud_maker: Python ----------
import Rhino as rh 
import Rhino.Geometry as rg
import scriptcontext as sc 
import rhinoscriptsyntax as rs 

import polars

block_spacing = 100


# Iterate and split string by lines then by '_'
project_data = [line.split('_') for line in project_info.splitlines()]
origin = origin_point.Clone()


# Use project_data to create lists by type
sizes = [el[0] for el in project_data]
diameters = [int(el[1]) for el in project_data]
counts = [int(el[2]) for el in project_data]


# Create the boundry for BlockInstance items
origin_offset = rh.Geometry.Point3d(origin.X + (sum(diameters)+((len(project_data)+1)*(block_spacing))),
                                   (origin.Y + sorted(diameters)[-1])+block_spacing,0)

#
origin_rect = rh.Geometry.Rectangle3d(rh.Geometry.Plane.WorldXY,origin, origin_offset)


#-----
def make_circles():
    # Create empty list
    circles = []

    # Enumerate (get index and item) the diameters list
    for i, diameter in enumerate(diameters):
        radius = diameter/2
        if i > 0:
            offset = sum(diameters[:i])
            spacing = block_spacing*(i+1)
            a_pt = rh.Geometry.Point3d(origin.X + ((offset+spacing+radius)),
                                       origin.Y + (sorted(diameters)[-1]/2)+block_spacing/2,0)
        else:
            a_pt = rh.Geometry.Point3d(origin.X + ((radius)+block_spacing),
                                       origin.Y + (sorted(diameters)[-1]/2),0)

        circle = rh.Geometry.Circle(a_pt, radius)
        circle_srf = rh.Geometry.Brep.CreatePlanarBreps([circle.ToNurbsCurve()],.01)
        circles.append(circle)
    return circles
#-----


#-----
sc.doc = rh.RhinoDoc.ActiveDoc
#-----


info_dict = {"size": "small", 
             "depth":default_baffle_depth,
             "color":"color",
             "row":""
             }
#-----
# Create color list (example)
colors = ["red","green","blue","purple"]



# Create function to build cloud blocks
def make_blocks(block_curves):

    # iterate the passed curve to become blocks
    for i, block_curve in enumerate(block_curves):

        # get sizes list value at index
        block_name = sizes[i]

        # for i, count in enumerate(counts):
        # create key/value paired values - f-string is taking i value
        key, val = "color", f"{colors[i]}"

        # look for blocks with the name that is equal to block_name
        id_def = sc.doc.InstanceDefinitions.Find(block_name)

        # if the block exists -> delete it.
        if id_def is not None:
            sc.doc.InstanceDefinitions.Delete(id_def)

        # create vectors for element transform to the center of bloick_curve
        vec = rh.Geometry.Vector3d(block_curve.Center)
        xform = rh.Geometry.Transform.Translation(vec)

        # # creete text_entity for block
        text = rh.Geometry.TextEntity()
        text.TextHeight = 60 # <--- TEXT HEIGHT VALUE
        text.Transform(xform, text.DimensionStyle)
        text.Transform(rh.Geometry.Transform.Translation(-300,+300,0), text.DimensionStyle)
        #
        name_text = text.Duplicate()
        name_text.RichText = "Id - %<UserText('block','id')>%"
        name_text.Transform(rh.Geometry.Transform.Translation(0,0,0), text.DimensionStyle)
        #
        size_text = text.Duplicate()
        size_text.RichText = "Size - %<UserText('block','size')>%"
        size_text.Transform(rh.Geometry.Transform.Translation(0,-80,0), text.DimensionStyle)
        #
        depth_text = text.Duplicate()
        depth_text.RichText = "Depth - %<UserText('block','depth')>%"
        depth_text.Transform(rh.Geometry.Transform.Translation(0,-160,0), text.DimensionStyle)
                #
        color_text = text.Duplicate()
        color_text.RichText = "Color - %<UserText('block','color')>%"
        color_text.Transform(rh.Geometry.Transform.Translation(0,-240,0), text.DimensionStyle)
        #
        height_text = text.Duplicate()
        height_text.RichText = "Height - %<UserText('block','height')>%"
        height_text.Transform(rh.Geometry.Transform.Translation(0,-320,0), text.DimensionStyle)
        #
        row_text = text.Duplicate()
        row_text.RichText = "Row - %<UserText('block','rows')>%"
        row_text.Transform(rh.Geometry.Transform.Translation(0,-400,0), text.DimensionStyle)
        #
        path = sc.doc.Layers.FindByFullPath("Blocks::geometry", True)
        sc.doc.Layers.SetCurrentLayerIndex(path, True)

        # attempt to add a new block based on the passed items list ex. -> [circle.ToNurbsCurve(), my_text]
        block_items = [block_curve.ToNurbsCurve(), size_text, depth_text, color_text, height_text, name_text, row_text]
      
        sc.doc.InstanceDefinitions.Add(block_name, "Dynamic block", block_curve.Center, block_items)


if RUN:
    circles = make_circles()
    make_blocks(circles)
    
#-----
    clouds = []
    for i, size in enumerate(sizes):
        spacing = block_spacing*(i+1)
        block_id = sc.doc.InstanceDefinitions.Find(size)
        offset = sum(diameters[:i])
        for j in range(counts[i]):
            #
            vec = rh.Geometry.Vector3d(origin.X+(offset+diameters[i]/2+spacing),origin.Y+(j*(diameters[i]+block_spacing)), 0)
            xform = rh.Geometry.Transform.Translation(vec)
            #
            instance_id = sc.doc.Objects.AddInstanceObject(block_id.Index,  xform)
            instance_object = sc.doc.Objects.Find(instance_id)
            #
            # print([string for string in instance_object.Attributes.GetUserStrings()])
            #
            instance_object.Attributes.SetUserString("id", f"{size}_{j}")
            instance_object.Attributes.SetUserString("size", f"{size}")
            instance_object.Attributes.SetUserString("depth", str(default_baffle_depth))
            instance_object.Attributes.SetUserString("color", f"none"),
            instance_object.Attributes.SetUserString("height", str(0))
            instance_object.Attributes.SetUserString("rows", f"none")
            instance_object.Attributes.Name = f"cloud_{i}_{j}"
            # instance_object.Attributes.Transform(x2)
        for obj in block_id.GetObjects():
            #
            if type(obj.Geometry) == rh.Geometry.TextEntity:
                target = sc.doc.Layers.FindByFullPath("Blocks::text",False)
                obj.Attributes.LayerIndex = target
                obj.CommitChanges()

        sc.doc.Views.Redraw()
#-----
# ---------- end cloud_maker ----------
grid_maker = Python3Script(
    RUN=run_2,
    perimeter=crv,
    perimeter_index=Slider(0, range=0..10),
    row_count=Slider(67, range=1..1000),
    baffle_spacing=Slider(100, range=1..10000),
    extra_baffles=Slider(1, range=1..1000),
    grid_extension=Slider(17.1, range=0.1..100),
    grid_row_count=Slider(1, range=1..10))  # -> a, b, graft(c), e, f, g; inputs perimeter: Curve, perimeter_index: Int32, row_count: Int32, baffle_spacing: Int32, extra_baffles: Int32, grid_extension: Double, grid_row_count: Int32
# ---------- grid_maker: Python ----------
import Rhino as rh
import scriptcontext as sc

import System

# -----
perimeter = perimeter.ToPolyline().BreakAtAngles(5)
print(perimeter.Count)
#
perimeter_index = (len(perimeter) - 1 if perimeter_index >= len(perimeter) else perimeter_index)
#
perimeter_brep = rh.Geometry.Brep.CreatePlanarBreps([crv.ToNurbsCurve()  for crv in perimeter], 0.1)
#
grid_start_curve = perimeter[perimeter_index].ToNurbsCurve()
# -----

print(perimeter.Count)
ii = perimeter_brep[0]


# -----
a_pt, b_pt = grid_start_curve.PointAtNormalizedLength(0), grid_start_curve.PointAtNormalizedLength(1)
vecA, vecB  = rh.Geometry.Vector3d(a_pt), rh.Geometry.Vector3d(b_pt)
a_pt.X, a_pt.Y = a_pt.X + ((vecA.X - vecB.X) * grid_extension), a_pt.Y + ((vecA.Y - vecB.Y) * grid_extension)
b_pt.X, b_pt.Y = b_pt.X + (-(vecA.X - vecB.X) * grid_extension), b_pt.Y + (-(vecA.Y - vecB.Y) * grid_extension)
a_line = rh.Geometry.Line(b_pt, a_pt)
# -----

# -----
grid_curves = []
xsect_curves = []
for i in range(row_count):
    crv = a_line.ToNurbsCurve().Offset(rh.Geometry.Plane.WorldXY,((i + 1) * baffle_spacing),0.1,rh.Geometry.CurveOffsetCornerStyle.Sharp)
    grid_curves.append(crv[0])
    xsect = rh.Geometry.Intersect.Intersection.CurveBrepFace(crv[0], perimeter_brep[0].Faces[0], 0.01)
    # print(xsect)
    if len(xsect[1]) > 0:
        xsect_curves.append([x for x in xsect[1]][0])


#-----
sc.doc = rh.RhinoDoc.ActiveDoc
#-----


#
red = System.Drawing.Color.Red
green = System.Drawing.Color.Green
blue = System.Drawing.Color.Blue
orange = System.Drawing.Color.DarkOrange
magenta = System.Drawing.Color.Magenta
#
row_colors = [red,green,blue, orange, magenta]
sizes = ["small", "medium","large"]
characters = "abcdefghijklmnopqrstuvwxyz"
#
row_curves = [xsect_curves[0::3], xsect_curves[1::3], xsect_curves[2::3]]


row_curves2 = [xsect_curves[i::grid_row_count] for i in range(grid_row_count)]


if RUN:
    for i, size in enumerate(sizes):
        letter = characters[i].upper()
        print(letter)
        path_idx = sc.doc.Layers.FindByFullPath(f"Grid::rows{letter}::grid", False)
        print(path_idx)
        if path_idx < 0:
            sc.doc.Layers.Delete(sc.doc.Layers.FindIndex(path_idx))
            sc.doc.Layers.AddPath(f"Grid::rows{letter}::grid",row_colors[i])
            sc.doc.Layers.AddPath(f"Grid::rows{letter}::grid",row_colors[i])
        else:
            path = sc.doc.Layers.FindIndex(path_idx)
            sc.doc.Layers.Delete(path)



a = perimeter
b = xsect_curves
c = row_curves2
e, f, g = xsect_curves[0::3], xsect_curves[1::3], xsect_curves[2::3]
# ---------- end grid_maker ----------

layer_watch_list = Panel(active)
objects = QueryModelObjects(Layer=active, AutoUpdateState=True)  # -> flatten(Objects)
crv_5 = Curve(grid_maker.a)
panel_4 = Panel("E:/Projects/tpf/rhino/layered_shapes/code/")

# ----
# Overlay Machine
# Interactive Data Overlay
toggle = BooleanToggle(False)
crv_6 = Curve(<curve referenced from the Rhino model>)
crv_7 = Curve(<curve referenced from the Rhino model>)
grid_overlays = Python3Script(use_obstructions=toggle, mushroom=crv_6, perimeter=crv_7, objects=objects)  # -> data_out; inputs mushroom: Curve, perimeter: Curve, objects: list
# ---------- grid_overlays: Python ----------
import Rhino as rh
import Rhino.Geometry as rg
import scriptcontext as sc
import rhinoscriptsyntax as rs

# print(data_in.clouds)
sc.doc = rh.RhinoDoc.ActiveDoc


""" Curves """
# Dovetail Curves       
dovetail_layer_idx = sc.doc.Layers.FindByFullPath("RH_User_Input::dovetails", True)
dovetail_layer = sc.doc.Layers.FindIndex(dovetail_layer_idx)
dovetail_layer_objects = sc.doc.Objects.FindByLayer(dovetail_layer)
dovetail_layer_object_curves = [obj.Geometry for obj in dovetail_layer_objects]

# Strut Curves
strut_layer_idx = sc.doc.Layers.FindByFullPath("RH_User_Input::struts", True)
strut_layer = sc.doc.Layers.FindIndex(strut_layer_idx)
strut_layer_objects = sc.doc.Objects.FindByLayer(strut_layer)
strut_layer_object_curves = [obj.Geometry for obj in strut_layer_objects]

# Row Curves
base, rowsA, rowsB = sc.doc.Objects.FindByLayer(
    sc.doc.Layers.FindIndex(sc.doc.Layers.FindByFullPath("Grid::base::curves", False))
), sc.doc.Objects.FindByLayer(
    sc.doc.Layers.FindIndex(sc.doc.Layers.FindByFullPath("Grid::rowsA::grid", False))
), sc.doc.Objects.FindByLayer(
    sc.doc.Layers.FindIndex(sc.doc.Layers.FindByFullPath("Grid::rowsB::grid", False))
)

# Obstruction Curves   
obstruction_layer_idx = sc.doc.Layers.FindByFullPath("RH_User_Input::obstructions", True)
obstruction_layer = sc.doc.Layers.FindIndex(obstruction_layer_idx)
obstruction_layer_objects = sc.doc.Objects.FindByLayer(obstruction_layer)
obstruction_layer_object_curves = [obj.Geometry for obj in obstruction_layer_objects if type(obj) == rh.DocObjects.CurveObject]


""" Geometry """
b_base = [row.Geometry for row in base]
b_rowsA = [row.Geometry for row in rowsA]
b_rowsB = [row.Geometry for row in rowsB]
row_curves = b_base + b_rowsA + b_rowsB
end_points = []
for curve in row_curves:
    end_points.append(curve.PointAtStart)
    end_points.append(curve.PointAtEnd)


dovetail_point_list_base = []
dovetail_point_list_rowsA = []
dovetail_point_list_rowsB = []
#
for curve in dovetail_layer_object_curves:
    for i, row in enumerate(base):
        xsect_base = rg.Intersect.Intersection.CurveCurve(curve, row.Geometry, .01, .001)
        xsectA = rg.Intersect.Intersection.CurveCurve(curve, rowsA[i].Geometry, .01, .001)
        xsectB = rg.Intersect.Intersection.CurveCurve(curve, rowsB[i].Geometry, .01, .001)
        #
        if xsect_base.Count > 0:
            for x in xsect_base:
                dovetail_point_list_base.append(x.PointA)
        #
        if xsectA.Count > 0:
            for x in xsectA:
                dovetail_point_list_rowsA.append(x.PointA)
        #
        if xsectB.Count > 0:
            for x in xsectB:
                dovetail_point_list_rowsB.append(x.PointA)


strut_point_list_base = []
strut_point_list_rowsA = []
strut_point_list_rowsB = []
#
for curve in strut_layer_object_curves:
    for i, row in enumerate(base):
        xsect_base = rg.Intersect.Intersection.CurveCurve(curve, row.Geometry, .01, .001)
        xsectA = rg.Intersect.Intersection.CurveCurve(curve, rowsA[i].Geometry, .01, .001)
        xsectB = rg.Intersect.Intersection.CurveCurve(curve, rowsB[i].Geometry, .01, .001)
        #
        if xsect_base.Count > 0:
            for x in xsect_base:
                strut_point_list_base.append(x.PointA)
        #
        if xsectA.Count > 0:
            for x in xsectA:
                strut_point_list_rowsA.append(x.PointA)
        #
        if xsectB.Count > 0:
            for x in xsectB:
                strut_point_list_rowsB.append(x.PointA)


obstruction_point_list_base = []
obstruction_point_list_rowsA = []
obstruction_point_list_rowsB = []
obstruction_solids = []
for curve in obstruction_layer_object_curves:
    planar_brep = rg.Brep.CreatePlanarBreps([curve], .001)[0]
    xform = rg.Transform.Translation(0,0,-1000)
    planar_brep.Transform(xform)
    obstruction_solids.append(rg.Brep.CreateOffsetBrep(planar_brep, 2000.0, True, True, .001)[0][0])
    for i, row in enumerate(base):
        xsect_base = rg.Intersect.Intersection.CurveCurve(curve, row.Geometry, .01, .001)
        xsectA = rg.Intersect.Intersection.CurveCurve(curve, rowsA[i].Geometry, .01, .001)
        xsectB = rg.Intersect.Intersection.CurveCurve(curve, rowsB[i].Geometry, .01, .001)

        if xsect_base.Count > 0:
            for x in xsect_base:
                obstruction_point_list_base.append(x.PointA)

        if xsectA.Count > 0:
            for x in xsectA:
                obstruction_point_list_rowsA.append(x.PointA)

        if xsectB.Count > 0:
            for x in xsectB:
                obstruction_point_list_rowsB.append(x.PointA)


class Overlay:
    def __init__(self, name, perimeter, path):
        self.name = name
        self.perimeter = perimeter
        self.path = path

    def overlay_curves(self):
        layer_idx = sc.doc.Layers.FindByFullPath(self.path, True)
        layer = sc.doc.Layers.FindIndex(layer_idx)
        layer_objects = sc.doc.Objects.FindByLayer(layer)
        obs_curves = [obj.Geometry for obj in layer_objects if type(obj) == rh.DocObjects.CurveObject]
        return obs_curves

    def overlay_solids(self):
        curves = self.overlay_curves()
        obs_solids = []
        if curves is not None:
            for curve in curves:
                planar_brep = rg.Brep.CreatePlanarBreps([curve], .001)[0]
                # xform = rg.Transform.Translation(0,0,-1000)
                # planar_brep.Transform(xform)
                obs_solids.append(rg.Brep.CreateOffsetBrep(planar_brep, 3000.0, True, True, .001)[0][0])
            return obs_solids
        else:
            return None



con_profile = sc.doc.InstanceDefinitions.Find("connector_profile")
overlay = rg.Brep.CreatePlanarBreps([perimeter] + obstruction_layer_object_curves, .001)

overlay_test = Overlay(name = "obstructions", perimeter=perimeter,path = "RH_User_Input::obstructions" )



mushrooms = []
extruded_mushrooms = []
planes = []
for strut in strut_layer_object_curves:
    
    perp_plane = strut.ToPolyline().ToNurbsCurve().PerpendicularFrameAt(0)[-1]
    planes.append(strut.TryGetPlane()[-1])
    planes.append(perp_plane)
    # print(shroom)
    xform = rg.Transform.PlaneToPlane(rg.Plane.WorldXY, perp_plane)
    shroom = mushroom.Duplicate()
    shroom.Transform(xform)
    ptA, ptB = strut.ToPolyline().ToNurbsCurve().PointAtStart,strut.ToPolyline().ToNurbsCurve().PointAtEnd
    srf_extrude = rg.Surface.CreateExtrusion(shroom, rg.Vector3d(ptB.X-ptA.X, ptB.Y-ptA.Y, 0))
    mushrooms.append(shroom)
    extruded_mushrooms.append(srf_extrude)


b = obstruction_point_list_base + obstruction_point_list_rowsA + obstruction_point_list_rowsB
c = dovetail_point_list_base + dovetail_point_list_rowsA + dovetail_point_list_rowsB
f = planes
g = mushrooms
h = extruded_mushrooms
i = end_points
j = overlay_test.overlay_solids()
k = overlay
print(overlay_test.name)
# ---------- end grid_overlays ----------

pt_3 = Point(<point referenced from the Rhino model>)
crv_8 = Curve(<curve referenced from the Rhino model>)
dovetail_dev = Python3Script(
    origin=pt_3,
    baseline_curve=crv_8,
    tail_swap=Toggle(True),
    tail_inset=Slider(0.1, range=0.1..1000),
    end_curve_length=Slider(0.1, range=0.1..100000))  # -> a, b, c, tail_points; inputs origin: Point3d, baseline_curve: Curve, tail_inset: Double, end_curve_length: Double
# ---------- dovetail_dev: Python ----------
import Rhino as rh 
import Rhino.Geometry as rg
import scriptcontext as sc


""" Properties """
baseline = baseline_curve
# dovetail_start_depth = 50
tail_btm_width = 15
tail_top_width = 35
tail_offset = tail_top_width+tail_btm_width
pocket_depth = 30 if tail_swap else -30
#
start_point, end_point = rg.Point3d(baseline.PointAtStart), rg.Point3d(baseline.PointAtEnd)


# """ Make Tail"""
# def make_tail():
#     #
#     for i in range(4):
#         #
#         ptA, ptB = rg.Point3d(start_point), rg.Point3d(start_point)
#         #  
#         if int(start_point.Y) == int(end_point.Y):
#             ptA.Z, ptB.Z = ptA.Z+(tail_btm_width/2), ptB.Z-(tail_btm_width/2)
#             ptAA, ptBB = rg.Point3d(ptA), rg.Point3d(ptB)
#             xformA = rg.Transform.Translation(pocket_depth, 0, +((tail_top_width-tail_btm_width)/2))
#             xformB = rg.Transform.Translation(pocket_depth, 0, -((tail_top_width-tail_btm_width)/2))
#         #
#         else:
#             ptA.Y, ptB.Y = ptA.Y+(tail_btm_width/2), ptB.Y-(tail_btm_width/2)
#             ptAA, ptBB = rg.Point3d(ptA), rg.Point3d(ptB)
#             xformA = rg.Transform.Translation(pocket_depth, +((tail_top_width-tail_btm_width)/2), 0)
#             xformB = rg.Transform.Translation(pocket_depth, -((tail_top_width-tail_btm_width)/2), 0)
#         #
#         ptAA.Transform(xformA), ptBB.Transform(xformB)
#         #
#         tail = rg.Curve.CreateInterpolatedCurve([ptA, ptAA, ptBB, ptB], 1)
#         #
#     return tail



""" Make Tail """
def make_tail():
    for i in range(4):
        ptA, ptB = rg.Point3d(start_point), rg.Point3d(start_point)
        
        if int(start_point.Y) == int(end_point.Y):
            ptA.Z += tail_btm_width / 2
            ptB.Z -= tail_btm_width / 2
            xformA = rg.Transform.Translation(pocket_depth, 0, (tail_top_width - tail_btm_width) / 2)
            xformB = rg.Transform.Translation(pocket_depth, 0, -(tail_top_width - tail_btm_width) / 2)
        else:
            ptA.Y += tail_btm_width / 2
            ptB.Y -= tail_btm_width / 2
            xformA = rg.Transform.Translation(pocket_depth, (tail_top_width - tail_btm_width) / 2, 0)
            xformB = rg.Transform.Translation(pocket_depth, -(tail_top_width - tail_btm_width) / 2, 0)
        
        ptAA, ptBB = rg.Point3d(ptA), rg.Point3d(ptB)
        ptAA.Transform(xformA)
        ptBB.Transform(xformB)
        
        tail = rg.Curve.CreateInterpolatedCurve([ptA, ptAA, ptBB, ptB], 1)
    
    return tail











baseline_length = baseline.GetLength()
tail_count = int(baseline_length/(tail_top_width+tail_btm_width))
tail_locs = baseline.DivideByCount(tail_count, False)
tail_points = [baseline.PointAt(pt) for pt in tail_locs]
tails = []

for point in tail_points:
    tail = make_tail()
    if int(start_point.Y) == int(end_point.Y):
        vec = rg.Vector3d(0, 0, -(start_point.Z - point.Z))
    else:
        vec = rg.Vector3d(0, -(start_point.Y - point.Y),0)
    xform = rg.Transform.Translation(vec)
    tail.Transform(xform)
    tails.append(tail)




lines = []
start_curve = rg.Line(baseline.PointAtStart, tails[0].PointAtStart)
end_curve = rg.Line(tails[-1].PointAtEnd, baseline.PointAtEnd)

for i, tail in enumerate(tails):
    if i+1 < len(tails):
        a_line = rg.Line(tail.PointAtEnd, tails[i+1].PointAtStart)
        lines.append(a_line)

lines.insert(0,start_curve)
lines.append(end_curve)

dovetail_curve = rg.Curve.JoinCurves([el.ToNurbsCurve() for el in tails]+[el.ToNurbsCurve() for el in lines])[0]

vY = rg.Vector3d(0,0,1)
vX = rg.Vector3d(1,0,0)

start, end = baseline_curve.PointAtStart, baseline_curve.PointAtEnd

if start.Z < end.Z:
    baseline_curve.Reverse()

new_plane = rg.Plane(start, vX, vY)
#    return dovetail_curve


# dovetail_curve = rh.Geometry.Curve.CreateInterpolatedCurve(list_points, 1)
# a = baseline
# b = dovetail_curve
# c = tail_points
a = dovetail_curve
b = new_plane
# f = make_dovetail(baseline = baseline_curve)
# ---------- end dovetail_dev ----------

height = Slider(3000, range=0..10000)

# ----
# Project Machine
# Baffle Depth & Height Settings
cloud_machine = Python3Script(data_in=grid_overlays, project_info=panel_2, path=panel_4)  # -> data_out
# ---------- cloud_machine: Python ----------
import Rhino as rh 
import Rhino.Geometry as rg
import scriptcontext as sc 

import itertools


sc.doc = rh.RhinoDoc.ActiveDoc 


import sys
import importlib as imp
sys.path.append(path)

import layered_shapes as pjct
imp.reload(pjct)



# Iterate and split string by lines then by '_'
project_data = [line.split('_') for line in project_info.splitlines()]
# origin = origin_point.Clone()


# Use project_data to create lists by type
sizes = [el[0] for el in project_data]
diameters = [int(el[1]) for el in project_data]
counts = [int(el[2]) for el in project_data]




""" Cloud Class """
# class Cloud:
#     #
#     def __init__(self, block, name=""):
#         self.name = name
#         self.block = block
#         self.boundry= None
#         self.center = None
#         self.baffle_curves = []
#         self.info = {}

#         # explode the block to access interanals
#         parts = self.block.Explode(True)[0]

#         # set transformations
#         vec = rh.Geometry.Vector3d(self.block.InsertionPoint)
#         xform = rh.Geometry.Transform.Translation(vec)

#         # get the cloud geometries
#         circle = parts[0].Geometry.TryGetCircle()[-1]
#         circle.Transform(xform) 
#         self.boundry = circle
#         self.center = circle.Center

#     # xy surface
#     def boundry_surface(self):
#         for obj in self.block.GetSubObjects():
#             if type(obj.Geometry) == rh.Geometry.NurbsCurve:
#                 return rh.Geometry.Brep.CreatePlanarBreps([obj.Geometry], .01)[0]

#     # xz baffle surfaces
#     def cloud_surfaces(self):
#         surfaces = []
#         depth = self.block.Attributes.GetUserString("depth")
#         for curve in self.baffle_curves: 
#             if len(self.baffle_curves) > 0:
#                 extrude = rg.Extrusion.Create(curve, -(float(depth)), False)
#                 if extrude is not None:
#                     extrude.ToBrep()
#                 surfaces.append(extrude)
#         return surfaces

#     # xz cloud baffle surfaces
#     def cloud_baffle_surfaces(self):
#         surfaces = []
#         height = self.block.Attributes.GetUserString("height")
#         srfs = self.cloud_surfaces()
#         for srf in srfs:
#             srf.Translate(0,0,float(height))
#             surfaces.append(srf)
#         return surfaces

#     # xz cloud baffle curves
#     def cloud_surface_curves(self):
#         curves = []
#         for srf in self.cloud_surfaces():
#             edge_curve = rg.Curve.JoinCurves(srf.ToBrep().Edges)
#             # print(edge_curve[0])

#             # filletA = rg.Curve.CreateFillet(edge_curve[1], edge_curve[0], 10,5,5)
#             curves.append(edge_curve[0])
#             # print(curves)
#         return curves


""" Area Elements """
perimeter_layer = sc.doc.Layers.Find("areas", False)
perimeter = sc.doc.Objects.FindByLayer(sc.doc.Layers.FindIndex(perimeter_layer))[0].Geometry
# #
# surface = rh.Geometry.Brep.CreatePlanarBreps(perimeter,.01)[0]
# #
# offset_brep = rh.Geometry.Brep.CreateOffsetBrep(surface,2000,True,True,.01)


""" Create Cloud List """
clouds = []
for size in sizes:
    # find the size block
    block = sc.doc.InstanceDefinitions.Find(f"{size}")
    # get the block references
    block_refs = block.GetReferences(0)
    # Create clouds 
    # TODO: create user text values & commit_changes()
    for block_obj in block_refs:
        cloud = pjct.Project.Cloud(block_obj)
        clouds.append(cloud)


""" Get Active Clouds """
active_clouds = []
for cloud in clouds:
    #
    print(cloud)
    contained = perimeter.Contains(cloud.center)
    intersect = rh.Geometry.Intersect.Intersection.CurveCurve(perimeter, cloud.boundary.ToNurbsCurve(), .01, .01)
    #
    if intersect or int(contained) == 1 or 0:
        active_clouds.append(cloud)
        #
        layer_idx = cloud.block.Attributes.LayerIndex
        layer = sc.doc.Layers.FindIndex(layer_idx)
        #
        row = str(layer).split("::")[1][-1]
        cloud.block.Attributes.SetUserString("rows", row)
        cloud.block.CommitChanges()


class Data:
    pass
 
data_out = Data()
print(active_clouds)
data_out.active_clouds = active_clouds
# ---------- end cloud_machine ----------
baffle_engine = Python3Script(
    data_in=cloud_machine,
    base_depth=number_slider,
    base_baffle_height=height,
    edge_radius=Slider(100, range=0.01..100),
    path=panel_4)  # -> data_out, cloud_baffles, cloud_surfaces, cloud_baffle_curves, base_baffles, base_surfaces, base_solids, g; inputs base_depth: Double
# ---------- baffle_engine: Python ----------
import Rhino as rh
import Rhino.Geometry as rg
import scriptcontext as sc

import sys
import importlib as imp
sys.path.append(path)

import layered_shapes as pjct
imp.reload(pjct)

# Retrieve from data_input
active_clouds = data_in.active_clouds

# set env
sc.doc = rh.RhinoDoc.ActiveDoc





def make_baffle(baffle_curve, radius, depth=-100):
    """Create a baffle profile with filleted corners.
    
    Args:
        baffle_curve: The top curve of the baffle
        radius: Fillet radius for bottom corners
        depth: Vertical depth of the baffle (default: -100)
    
    Returns:
        A joined curve representing the baffle profile
    """
    # Create top and bottom curves
    top_crv = baffle_curve.ToNurbsCurve()
    btm_crv = top_crv.Duplicate()
    btm_crv.Transform(rg.Transform.Translation(0, 0, depth))
    
    # Create vertical edges
    right_edge = rg.Line(top_crv.PointAtStart, btm_crv.PointAtStart).ToNurbsCurve()
    left_edge = rg.Line(top_crv.PointAtEnd, btm_crv.PointAtEnd).ToNurbsCurve()
    
    # Create fillets at bottom corners
    fillet_right = rg.Curve.CreateFillet(right_edge, btm_crv, radius, 50, 50).ToNurbsCurve()
    fillet_left = rg.Curve.CreateFillet(left_edge, btm_crv, radius, 50, 50).ToNurbsCurve()
    
    # Create connecting segments
    conn_right = rg.Line(fillet_right.PointAtStart, top_crv.PointAtStart).ToNurbsCurve()
    conn_bottom = rg.Line(fillet_right.PointAtEnd, fillet_left.PointAtEnd).ToNurbsCurve()
    conn_left = rg.Line(fillet_left.PointAtStart, top_crv.PointAtEnd).ToNurbsCurve()
    
    # Join all curves into a single profile
    return rg.Curve.JoinCurves([top_crv, conn_right, fillet_right, conn_bottom, fillet_left, conn_left], .001)[0]






# iterate active clouds
for cloud in active_clouds:
    intersected = []
    cloud_row = cloud.block.Attributes.GetUserString("rows")
    cloud_depth = cloud.block.Attributes.GetUserString("depth")
    cloud_layer_idx = sc.doc.Layers.FindByFullPath(
        f"Grid::rows{cloud_row}::grid", True
    )
    cloud_layer = sc.doc.Layers.FindIndex(cloud_layer_idx)
    cloud_row_curves = sc.doc.Objects.FindByLayer(cloud_layer)
    for row_curve in cloud_row_curves:
        if type(row_curve.Geometry) == rg.LineCurve:
            xsect = rg.Intersect.Intersection.CurveBrepFace(
                row_curve.Geometry, cloud.boundary_surface().Faces[0], 0.01
            )
            if len(xsect[1]) > 0:
                intersected.append(xsect[1][0])
    # print(cloud.cloud_curves())
    cloud.baffle_curves = intersected


""" Cloud Baffle Solids """
# solids = []
# for cloud in active_clouds:

#     height = cloud.block.Attributes.GetUserString("height")
#     for surface in cloud.cloud_baffle_surfaces():
#         print(surface)
#         if surface is not None:
#             print(surface)
    #         surface = surface.ToBrep()
    #         offset = rg.Brep.CreateOffsetBrep(surface, -12.5, False, True, 0.01)[0][0]
    #         solid = rg.Brep.CreateOffsetBrep(offset, 25, True, True, 0.01)[0][0]
    #         solids.append(solid)


baffle_curves = []
for cloud in active_clouds:
    print(cloud)
    depth = cloud.depth[0] if isinstance(cloud.depth, list) else cloud.depth
    for crv in cloud.baffle_curves:
        baffle_curves.append(make_baffle(crv, edge_radius, -(float(depth))))


cloud_baffles = []
for baffle in baffle_curves:
    if baffle.IsClosed:
        try:
            cloud_baffles.append(rg.Brep.CreatePlanarBreps(baffle,.001))
        except TypeError:
            pass


cloud_baffles = [el[0] for el in cloud_baffles]

# """ Cloud Surfaces """
# surfaces = []
# baffle_surfaces = []
# for cloud in active_clouds:
#     height = cloud.block.Attributes.GetUserString("height")
#     for surface in cloud.cloud_surfaces():
#         surface.Translate(0,0,float(height))
#         surfaces.append(surface)


""" Hanging Curves """
struts = []
strut_layer_idx = sc.doc.Layers.Find("struts", False)
strut_layer = sc.doc.Layers.FindIndex(strut_layer_idx)
strut_curves = sc.doc.Objects.FindByLayer(strut_layer)
for strut in strut_curves:
    xform = rg.Transform.Translation(0,0,base_baffle_height)
    # print(strut.Geometry)
    strut.Geometry.Transform(xform)
    struts.append(strut.Geometry)


""" Dovetail Curves """
dovetails = []
dt_layer_idx = sc.doc.Layers.Find("dovetails", False)
dt_layer = sc.doc.Layers.FindIndex(dt_layer_idx)
dt_curves = sc.doc.Objects.FindByLayer(dt_layer)
for crv in dt_curves:
    xform = rg.Transform.Translation(0,0,base_baffle_height)
    crv.Geometry.Transform(xform)
    dovetails.append(crv.Geometry)
# print(dovetails)


""" Base Baffle Grid """
base_baffle_idx = sc.doc.Layers.FindByFullPath("Grid::base::curves", True)
base_baffle_layer = sc.doc.Layers.FindIndex(base_baffle_idx)
#
base_curves = sc.doc.Objects.FindByLayer(base_baffle_layer)
base_curves = [el.Geometry for el in base_curves]
#





base_solids = []
base_surfaces = []
for curve in base_curves:
    surface = rg.Extrusion.Create(curve, -base_depth, False).ToBrep()
    extrude = surface.Duplicate()
    extrude.Translate(0, 0, base_baffle_height)
    offset = rg.Brep.CreateOffsetBrep(extrude, -12.5, False, True, 0.01)[0][0]
    solid = rg.Brep.CreateOffsetBrep(offset, 25, True, True, 0.01)[0][0]
    # base_surfaces.append(surface)
    base_solids.append(solid)
    print(surface)
    # base_surfaces.append(make_baffle(surface, edge_radius))




# Obstruction Curves   
obstruction_layer_idx = sc.doc.Layers.FindByFullPath("RH_User_Input::obstructions", True)
obstruction_layer = sc.doc.Layers.FindIndex(obstruction_layer_idx)
obstruction_layer_objects = sc.doc.Objects.FindByLayer(obstruction_layer)
obstruction_layer_object_curves = [obj.Geometry for obj in obstruction_layer_objects if type(obj) == rh.DocObjects.CurveObject]



# cloud_baffles = solids
# cloud_surfaces = surfaces
base_baffles = base_solids
base_surfaces = base_surfaces
e = dovetails
# f = surfaces

class Data:
    pass

data = Data()

data.clouds = data_in.active_clouds
data.base_surfaces = base_surfaces
data.cloud_surfaces = cloud_surfaces
data_out = data
# ---------- end baffle_engine ----------

crv_9 = Curve(dovetail_dev.a)
pt_4 = Point(dovetail_dev.tail_points)
pln_3 = Plane(dovetail_dev.b)
pt_5 = Point(dovetail_dev.c)
srf_2 = Surface(<surface referenced from the Rhino model>)
area_info = Script(project_library_path=panel_4)  # -> data_output
# ---------- area_info: Python ----------
import Rhino as rh
import Grasshopper as gh
import ghpythonlib.components as ghcomp
import scriptcontext as sc
import rhinoscriptsyntax as rs

import sys
import importlib as imp


sys.path.append(project_library_path)



import projectpy as pjct
imp.reload(pjct)



sc.doc = rh.RhinoDoc.ActiveDoc


print(pjct.Project.Cloud)
# ---------- end area_info ----------
panel_5 = Panel("E:/Projects/rjcd/rhino/layered_shapes/code")

boolean_regions = Python3Script(dt_curves=crv_9, dt_plane=pln_3, srf_plane=pln_2, intersector_surface=srf_2, index=Slider(3, range=0..10))  # -> regions, closed, a; inputs dt_curves: Curve, dt_plane: Plane, srf_plane: Plane, intersector_surface: Surface, index: Int32
# ---------- boolean_regions: Python ----------
import Rhino as rh
import Rhino.Geometry as rg 
import scriptcontext as sc 

xform = rg.Transform.PlaneToPlane(dt_plane, srf_plane)
dt_curves.Transform(xform)
intersect_curve = rg.Curve.JoinCurves(intersector_surface.ToBrep().DuplicateEdgeCurves())[0]
print(intersect_curve)
intersectors = [intersect_curve]+[dt_curves]
#sects = rg.Curve.CreateBooleanRegions(intersectors, rg.Plane.WorldXY, False, .001)
sects = rg.Curve.CreateBooleanRegions(intersectors, srf_plane, False, .001)
print(sects.RegionCount)


regions = []
for i in range(sects.RegionCount):
    crv = sects.RegionCurves(i)[0]
    srf = rg.Brep.CreatePlanarBreps(crv, .001)[0]
    regions.append(srf)

if index < len(intersectors):
    closed = regions[index-1]


print(sects)
# ---------- end boolean_regions ----------
crv_10 = Curve(boolean_regions.regions)

crv_11 = Curve(<curve referenced from the Rhino model>)
dovetail_struts = Python3Script(mushroom=crv_11)  # -> data_out, f, g, h; inputs mushroom: Curve
# ---------- dovetail_struts: Python ----------
import Rhino as rh
import Rhino.Geometry as rg
import scriptcontext as sc
import rhinoscriptsyntax as rs

# print(data_in.clouds)
sc.doc = rh.RhinoDoc.ActiveDoc


""" Curves """
# Dovetail Curves       
dovetail_layer_idx = sc.doc.Layers.FindByFullPath("RH_User_Input::dovetails", True)
dovetail_layer = sc.doc.Layers.FindIndex(dovetail_layer_idx)
dovetail_layer_objects = sc.doc.Objects.FindByLayer(dovetail_layer)
dovetail_layer_object_curves = [obj.Geometry for obj in dovetail_layer_objects]

# Strut Curves
strut_layer_idx = sc.doc.Layers.FindByFullPath("RH_User_Input::struts", True)
strut_layer = sc.doc.Layers.FindIndex(strut_layer_idx)
strut_layer_objects = sc.doc.Objects.FindByLayer(strut_layer)
strut_layer_object_curves = [obj.Geometry for obj in strut_layer_objects]

# Row Curves
base, rowsA, rowsB = sc.doc.Objects.FindByLayer(
    sc.doc.Layers.FindIndex(sc.doc.Layers.FindByFullPath("Grid::base::curves", False))
), sc.doc.Objects.FindByLayer(
    sc.doc.Layers.FindIndex(sc.doc.Layers.FindByFullPath("Grid::rowsA::curves", False))
), sc.doc.Objects.FindByLayer(
    sc.doc.Layers.FindIndex(sc.doc.Layers.FindByFullPath("Grid::rowsB::curves", False))
)



""" Geometry """
b_base = [row.Geometry for row in base]
b_rowsA = [row.Geometry for row in rowsA]
b_rowsB = [row.Geometry for row in rowsB]
row_curves = b_base + b_rowsA + b_rowsB
end_points = []
for curve in row_curves:
    end_points.append(curve.PointAtStart)
    end_points.append(curve.PointAtEnd)


dovetail_point_list_base = []
dovetail_point_list_rowsA = []
dovetail_point_list_rowsB = []
#
for curve in dovetail_layer_object_curves:
    for i, row in enumerate(base):
        xsect_base = rg.Intersect.Intersection.CurveCurve(curve, row.Geometry, .01, .001)
        xsectA = rg.Intersect.Intersection.CurveCurve(curve, rowsA[i].Geometry, .01, .001)
        xsectB = rg.Intersect.Intersection.CurveCurve(curve, rowsB[i].Geometry, .01, .001)
        #
        if xsect_base.Count > 0:
            for x in xsect_base:
                dovetail_point_list_base.append(x.PointA)
        #
        if xsectA.Count > 0:
            for x in xsectA:
                dovetail_point_list_rowsA.append(x.PointA)
        #
        if xsectB.Count > 0:
            for x in xsectB:
                dovetail_point_list_rowsB.append(x.PointA)


strut_point_list_base = []
strut_point_list_rowsA = []
strut_point_list_rowsB = []
#
for curve in strut_layer_object_curves:
    for i, row in enumerate(base):
        xsect_base = rg.Intersect.Intersection.CurveCurve(curve, row.Geometry, .01, .001)
        xsectA = rg.Intersect.Intersection.CurveCurve(curve, rowsA[i].Geometry, .01, .001)
        xsectB = rg.Intersect.Intersection.CurveCurve(curve, rowsB[i].Geometry, .01, .001)
        #
        if xsect_base.Count > 0:
            for x in xsect_base:
                strut_point_list_base.append(x.PointA)
        #
        if xsectA.Count > 0:
            for x in xsectA:
                strut_point_list_rowsA.append(x.PointA)
        #
        if xsectB.Count > 0:
            for x in xsectB:
                strut_point_list_rowsB.append(x.PointA)


con_profile = sc.doc.InstanceDefinitions.Find("connector_profile")



mushrooms = []
extruded_mushrooms = []
planes = []
for strut in strut_layer_object_curves:
    
    perp_plane = strut.ToPolyline().ToNurbsCurve().PerpendicularFrameAt(0)[-1]
    planes.append(strut.TryGetPlane()[-1])
    planes.append(perp_plane)
    # print(shroom)
    xform = rg.Transform.PlaneToPlane(rg.Plane.WorldXY, perp_plane)
    shroom = mushroom.Duplicate()
    shroom.Transform(xform)
    ptA, ptB = strut.ToPolyline().ToNurbsCurve().PointAtStart,strut.ToPolyline().ToNurbsCurve().PointAtEnd
    srf_extrude = rg.Surface.CreateExtrusion(shroom, rg.Vector3d(ptB.X-ptA.X, ptB.Y-ptA.Y, 0))
    mushrooms.append(shroom)
    extruded_mushrooms.append(srf_extrude)



f = planes
g = mushrooms
h = extruded_mushrooms
i = end_points
# ---------- end dovetail_struts ----------
crv_12 = Curve(boolean_regions.closed)
pt_6 = Point(<point referenced from the Rhino model>)
pln_4 = Plane(dovetail_struts.f)
brep = Brep(dovetail_struts.g)
srf_3 = Surface(dovetail_struts.h)
py3 = Python3Script(cut_plane_point=pt_6, baffle_parts=crv_10, baffle_plane=pln_2)  # -> a, b; inputs cut_plane_point: Point3d, baffle_parts: list of Curve, baffle_plane: Plane
# ---------- py3: Python ----------
import Rhino as rh
import Rhino.Geometry as rg


a_part = baffle_parts[0].ToNurbsCurve()
solid = rg.Brep.CreateOffsetBrep(rg.Brep.CreatePlanarBreps(a_part, .001)[0], -12,True,True, .001)[0][0]


vX = rg.Vector3d(1,0,0)
vY = rg.Vector3d(0,1,0)

a_plane = rg.Plane(cut_plane_point, vX, vY)
print(a_plane)
xform = rg.Transform.PlaneToPlane(baffle_plane, a_plane)
solid.Transform(xform)

a = solid



vX = rg.Vector3d(1,0,0)
vY = rg.Vector3d(0,1,0)

baffles_cut = []
for part in baffle_parts:
    baffle_solid = rg.Brep.CreateOffsetBrep(rg.Brep.CreatePlanarBreps(part, .001)[0], -12,True,True, .001)[0][0]
    cut_plane = rg.Plane(cut_plane_point, vX, vY)
    xform = rg.Transform.PlaneToPlane(baffle_plane, cut_plane)
    baffle_solid.Transform(xform)
    baffles_cut.append(baffle_solid)

# a = baffles_cut
b = baffles_cut
# ---------- end py3 ----------

brep_2 = Brep(baffle_engine.cloud_baffles)
brep_3 = Brep(baffle_engine.cloud_surfaces)
crv_13 = Curve(baffle_engine.cloud_baffle_curves)

brep_4 = Brep(baffle_engine.base_baffles)
brep_5 = Brep(baffle_engine.base_surfaces)

# ----
# Nesting
number_slider_2 = Slider(1, range=1..100)
pt_7 = Point()  # disabled
nesting_machine = IronPython2Script(
    cut_geo=baffle_engine.g,
    sheet_point=pt_7,
    sheet_x=Slider(100, range=1..100),
    sheet_y=Slider(45, range=1..100),
    spacing=Slider(0.1, range=0.1..1),
    placement=number_slider_2,
    tolerance=Slider(0.1, range=0.1..1),
    rotations=Slider(1, range=1..100),
    iteration=Slider(1, range=1..100),
    seed=Slider(1, range=1..100),
    reset=Button(),
    run=Toggle(False),
    overage=Slider(0.1, range=0.1..1))  # -> data_output; disabled
# ---------- nesting_machine: IronPython ----------
import ghpythonlib as gp




sheets = []
geo = []
spacing = 0
placement = None
tolerance = .01
rotations = 2
iterations = 1
seed = 0
reset = None
run = None
nest = gp.components.OpenNest.OpenNest(
    sheets = sheets,
    geo = geo,
    spacing = spacing,
    placement = placement,
    tolerance = tolerance,
    rotations = rotations,
    iterations = iterations,
    seed = seed,
    reset = reset,
    run = run
)
# ---------- end nesting_machine ----------

data_machine = Python3Script(data_in=baffle_engine.data_out)  # -> data_out; unedited script template
py3_2 = Python3Script(clouds=brep_2, base=brep_5)  # -> cloud_solids, base_solids; inputs clouds: list of Surface, base: list of Surface
# ---------- py3_2: Python ----------
import Rhino as rh
import Rhino.Geometry as rg

cloud_solids = []
for el in clouds:
    cloud_solids.append(el)
    # offset = el.Offset(-12.5,.01).ToBrep()
    # solid = rg.Brep.CreateOffsetBrep(offset, 25, True, True, .01)[0]
    # cloud_solids.append(solid)
# cloud_solids = [c[0] for c in cloud_solids]

# base_solids = []
# for el in base:
#     offset = el.Offset(-12.5,.01).ToBrep()
#     solid = rg.Brep.CreateOffsetBrep(offset, 25, True, True, .01)[0]
#     base_solids.append(solid)

# base_solids = [b[0] for b in base_solids]
# ---------- end py3_2 ----------
brep_6 = Brep(py3.b)

crv_14 = Curve(<curve referenced from the Rhino model>)
crv_15 = Curve(<curve referenced from the Rhino model>)
test_overlap = Python3Script(curveA=crv_14, curveB=crv_15)  # -> a, b, c; inputs curveA: Curve, curveB: Curve
# ---------- test_overlap: Python ----------
import Rhino as rh 
import scriptcontext as sc 

import polars as pl 


intersect = rh.Geometry.Intersect.Intersection.CurveCurve(curveA, curveB, .1,.1)

print(curveA)
print(intersect.Count)
print(intersect[0].PointA)
print(intersect[1].PointB)
ptA = rh.Geometry.Point3d(intersect[0].PointA)
ptB = rh.Geometry.Point3d(intersect[1].PointB)

#sect = rh.Geometry.Curve.CreateBooleanIntersection(curveA, curveB,.1)
sect = rh.Geometry.Curve.CreateBooleanUnion([curveA, curveB],.1)
print(sect)
# curve_list = rh.Geometry.Collections.BrepCurveList()
# curve_list.Add[curveA, curveB]
#split = curveA.Split([curveB.ToNurbsCurve().ToBrep()],.1,.1)
#print(split[0])
print(len(sect))
a = ptA
b = ptB
c = sect[0]
# ---------- end test_overlap ----------
pt_8 = Point(test_overlap.b)
pt_9 = Point(test_overlap.a)
crv_16 = Curve(test_overlap.c)

crv_17 = Curve(<curve referenced from the Rhino model>)
crv_18 = Curve([<curve referenced from the Rhino model> x3])
test_obstruct = Python3Script(outside=crv_17, inside=crv_18)  # -> a; inputs outside: Curve, inside: list of Curve
# ---------- test_obstruct: Python ----------
import Rhino as rh
import Rhino.Geometry as rg
import scriptcontext as sc


a_brep = rg.Brep.CreatePlanarBreps([outside]+inside, .001)

a = a_brep
# ---------- end test_obstruct ----------

test_pytorch = Python3Script()  # -> a
# ---------- test_pytorch: Python ----------
import torch 






if torch.cuda.is_available():
    device = torch.device("cuda")
else:
    device = torch.device("cpu")


random_points = torch.randint(5,50,(20,3))

print(torch.device(1))
print(random_points)
# ---------- end test_pytorch ----------
py3_3 = Python3Script(data_in=nesting_machine)  # -> data_out; unedited script template
